# Grasshopper definition 001.gh (Grasshopper 1.0.7)
# plug-ins: gHowl

pt = Point()
geo = Geometry()
panel = Panel(geo)
line = Line([Line((-9.323772904, -27.48943594, 9.87765329), (-22.85570715, -27.48943594, 9.87765329)), Line((-24.62679059, -5.338136033, 4.636556073), (-44.23199895, -5.338136033, 4.636556073))])
panel_2 = Panel(line)
geo_2 = Geometry([<brep referenced from the Rhino model>, <curve referenced from the Rhino model>, <brep referenced from the Rhino model>])
panel_3 = Panel(geo_2)
demesh = DeconstructMesh(Mesh=geo_2)  # -> Vertices, Faces, Colours, Normals
panel_4 = Panel(demesh.Faces)
c_script = CSharpScript()  # -> out, A
# ---------- c_script: C# additional code ----------
  /// <summary>
  /// This method will be called once every solution, before any calls to RunScript.
  /// </summary>
  public override void BeforeRunScript()
  { }
  /// <summary>
  Clear(All)
  /// This method will be called once every solution, after any calls to RunScript.
  /// </summary>
  public override void AfterRunScript()
  { }


  /// <summary>
  /// This method will be called once every solution, before any calls to RunScript.
  /// </summary>
  public override void BeforeRunScript()
  { }
  /// <summary>
  /// This method will be called once every solution, after any calls to RunScript.
  /// </summary>
  public override void AfterRunScript()
  { }


  /// <summary>
  /// This method will be called once every solution, before any calls to RunScript.
  /// </summary>
  public override void BeforeRunScript()
  { }
  /// <summary>
  /// This method will be called once every solution, after any calls to RunScript.
  /// </summary>
  public override void AfterRunScript()
  { }


  /// <summary>
  /// This method will be called once every solution, before any calls to RunScript.
  /// </summary>
  public override void BeforeRunScript()
  { }
  /// <summary>
  /// This method will be called once every solution, after any calls to RunScript.
  /// </summary>
  public override void AfterRunScript()
  { }


  /// <summary>
  /// This method will be called once every solution, before any calls to RunScript.
  /// </summary>
  public override void BeforeRunScript()
  { }
  /// <summary>
  /// This method will be called once every solution, after any calls to RunScript.
  /// </summary>
  public override void AfterRunScript()
  { }


  /// <summary>
  /// This method will be called once every solution, before any calls to RunScript.
  /// </summary>
  public override void BeforeRunScript()
  { }
  /// <summary>
  /// This method will be called once every solution, after any calls to RunScript.
  /// </summary>
  public override void AfterRunScript()
  { }


  /// <summary>
  /// This method will be called once every solution, before any calls to RunScript.
  /// </summary>
  public override void BeforeRunScript()
  { }
  /// <summary>
  /// This method will be called once every solution, after any calls to RunScript.
  /// </summary>
  public override void AfterRunScript()
  { }


  /// <summary>
  /// This method will be called once every solution, before any calls to RunScript.
  /// </summary>
  public override void BeforeRunScript()
  { }
  /// <summary>
  /// This method will be called once every solution, after any calls to RunScript.
  /// </summary>
  public override void AfterRunScript()
  { }
# ---------- end c_script ----------
panel_5 = Panel(demesh.Normals)
panel_6 = Panel(demesh.Vertices)
udp = UDPSender(Port=6001, Pattern=0)
