# Grasshopper definition 181119_SelPointsScript.gh (Grasshopper 1.0.7)
# plug-ins: Kangaroo2 Components

pt = Point([Point(-31.97020333, -25.84760304, 0), Point(-31.97020333, 87.05982001, 0), Point(8.797743919, 0, 0), Point(-46.96975944, 0, 0), Point(-12.87827873, -10.44440236, 0), Point(-12.87827873, -44.54968421, 0), Point(-12.87827873, 63.61217266, 0)])
pt_2 = Point([Point(59.80803252, -68.80512156, 0), Point(59.80803252, -43.53742562, 0), Point(81.96658724, -43.53742562, 0), Point(81.96658724, -65.73385105, 0), Point(67.54119463, -65.73385105, 0), Point(67.54119463, -54.71929421, 0)])
number_slider = Slider(3, range=0..3)
entwine = Entwine(Branch0X=pt, Branch1X=pt_2, FlattenInputs=False)
toggle = BooleanToggle(True)
trim = TrimTree(Tree=entwine, Depth=1)
anchorxyz = AnchorXYZ(Point=trim, X=toggle, Y=toggle, Z=toggle, Strength=1000)

# ----
# 1st
# select Points
grab = Grab(On=True, Strength=1, Range=number_slider)  # -> Grab, Anchors
solver = Solver(GoalObjects=[anchorxyz, grab.Grab], Reset=Button(), Threshold=1e-15, Tolerance=0.01, On=Toggle(True))  # -> I, V, O

tstat = TreeStatistics(Tree=trim)  # -> Paths, Length, Count
partition = PartitionList(List=solver.V, Size=tstat.Length)  # -> simplify(Chunks)
dist = Distance(PointA=trim, PointB=partition)
c_script = CSharpScript(x=dist, y=trim)  # -> out, A, B; inputs x: Double, y: Point3d
# ---------- c_script: C# ----------
    if ( x == 0 ) {
      A = x;
    }
    else {
      B = y;
    }
# ---------- end c_script ----------
toggle_2 = BooleanToggle(True)
clean = CleanTree(RemoveNulls=toggle_2, RemoveInvalid=toggle_2, RemoveEmpty=toggle_2, Tree=c_script.B)

# ----
# 4th
# clean List
rec = DataRecorder(clean, DataLimit=-10, RecordData=True)

msphere = MeshSphere(Base=rec, Radius=number_slider, UCount=10, VCount=20)
preview = CustomPreview(
    Geometry=msphere,
    Material={diffuse=RGB(221, 160, 221), emission=RGB(66, 48, 66), shine=0.5, specular=RGB(255, 255, 255), transparency=0})
# 2nd
# get index
mindex = MemberIndex(Set=trim, Member=rec)  # -> Index, Count
trim_2 = TrimTree(Tree=mindex.Index, Depth=1)
# 3rd
# get PLine with
# ref. Points
dam = DataDam(DataA=trim_2, BufferDelay=10000000, BufferMode=0)
item = ListItem(List=trim, Index=dam, Wrap=True)
cullpt = CullDuplicates(Points=item, Tolerance=0.001, CullMode=3)  # -> Points, Indices, Valence
trim_3 = TrimTree(Tree=cullpt.Points, Depth=1)
pline = PolyLine(Vertices=trim_3, Closed=Toggle(True))
