# Grasshopper definition StepByStep.gh (Grasshopper 1.0.7)
# plug-ins: Kangaroo2 Components, Kangaroo Components

mesh = Mesh(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)
# Another simple scripting example,
# showing how the simulation can
# be advanced one iteration at a time
nv = NakedVertices(Mesh=mesh)  # -> ClothedIndex, NakedIndex, ClothedPts, NakedPts
nv_2 = NakedVertices(Mesh=mesh)  # -> ClothedIndex, NakedIndex, ClothedPts, NakedPts
medges = MeshEdges(Mesh=mesh)  # -> NakedEdges, InteriorEdges, NonManifoldEdges
reset = Button(ExpressionPressed="true")
step = Button(ExpressionPressed="true")
length_line = LengthLine(Line=[medges.InteriorEdges, medges.NakedEdges], Length="0", Strength=10)
anchor = Anchor(Point=nv.NakedPts, Strength=1000)
# You will need to set the assembly
# reference location to your copy of
# KangarooSolver.dll
# Do this by right-clicking and then
# Manage Assemblies
customiteration = CSharpScript(
    Goals=[anchor, length_line],
    Reset=reset,
    Step=step,
    Reference="D:\Program Files\Rhino 6\Plug-ins\Grasshopper\Components\KangarooSolver.dll")  # -> out, A, B; inputs Goals: list, Reset: Boolean, Step: Boolean
# ---------- customiteration: C# ----------
    if(Reset)
    {
      PS = new KangarooSolver.PhysicalSystem();
      counter = 0;
      GoalList.Clear();
      foreach(IGoal G in Goals) //Assign indexes to the particles in each Goal:
      {
        PS.AssignPIndex(G, 0.0001); // the second argument is the tolerance distance below which points combine into a single particle
        GoalList.Add(G);
      }
    }
    if(Step)
    {
      PS.Step(GoalList, true, 1);
      counter++;
    }

    A = PS.GetOutput(GoalList);
    B = counter;
# ---------- customiteration: C# additional code ----------
  KangarooSolver.PhysicalSystem PS = new KangarooSolver.PhysicalSystem();
  List<IGoal> GoalList = new List<IGoal>();
  int counter = 0;
# ---------- end customiteration ----------
panel = Panel(customiteration.B)
