# Grasshopper definition Reciver test.gh (Grasshopper 1.0.7)
# plug-ins: gHowl, Kangaroo2 Components

brep = Brep(null)

# ----
# MeshDeconstruct and Sender
demesh = DeconstructMesh(Mesh=brep)  # -> Vertices, Faces, Colours, Normals

# ----
# UTP Sender
panel = Panel("127.0.0.1")
timer = Timer(Interval=5, TimerInterval=5, Target=udp)  # disabled
udp = UDPSender(Address=panel, Port="5000", Pattern="0", Data=[demesh.Faces, demesh.Vertices])
panel_2 = Panel(udp)

timer_2 = Timer(Interval=5, TimerInterval=5, Target=[udp_3, udp_2])  # disabled
udp_2 = UDPReceiver(Address="127.0.0.1", Port="5001", Pattern="0")  # -> Info, Data
udp_3 = UDPSender(Address="127.0.0.1", Port="3000", Pattern="0")  # disabled
panel_3 = Panel(udp_3)
panel_4 = Panel(udp_2.Info)
panel_5 = Panel(udp_2.Data)

panel_6 = Panel("5000")
panel_7 = Panel("Del{newline}{1}")
txt = Text("""Del
{1}""")

# ---- group: OK
# OK for button test
c_script = CSharpScript()  # -> out, Count, NewList; inputs PTList: list of Point3d, INmsg: Boolean, Run: Boolean, Reset: Boolean
# ---------- c_script: C# ----------
    Count = c / 2;
    Point3d PT = new Point3d(1, 1, 1);
    List<Point3d> List1;
    if(Run)
    {

      if(Reset)
      {
        Static.Clear();
        c = -1;
      }

      if (!hasStarted)
      {
        List1 = PTList;
      }
      else
      {
        if (Static.Count <= 0)
        {
          List1 = PTList;
        }
        else
        {
          List1 = Static;
        }
      }


      if (INmsg)
      {List1.Add(PT);}
      NewList = List1;
      Static = List1;
    }
# ---------- c_script: C# additional code ----------
  public int c;
  public static List<Point3d> Static;
  public bool hasStarted;
  /// <summary>
  /// This method will be called once every solution, before any calls to RunScript.
  /// </summary>
  public override void BeforeRunScript()
  {if (c <= 0)
      hasStarted = false;
    else
      hasStarted = true;
  }
  /// <summary>
  /// This method will be called once every solution, after any calls to RunScript.
  /// </summary>
  public override void AfterRunScript()
  {c++;}
# ---------- end c_script ----------

# ----
pt = Point([Point(0, 0, 0), Point(0, 1, 0)])

grassvrhandler = CSharpScript(
    PTList=pt,
    INmsg=txt,
    Run=Toggle(True),
    Reset=Button(),
    Reference=["C:\Users\giaco\Documents\tesi\scripts\DataConvTry\DataConvTry\bin\Release\netcoreapp2.1\DataConvTry.dll", "C:\Users\giaco\Documents\tesi\DLL\System.Linq.dll", "C:\Users\giaco\Documents\tesi\scripts\Grasshopper\GaviVRPlugin\GaviVRPlugin\bin\GaviVRPlugin.gha"])  # -> out, Count, NewList; inputs PTList: list of Point3d, INmsg: String, Run: Boolean, Reset: Boolean
# ---------- grassvrhandler: C# usings ----------
using System.Linq;
# ---------- grassvrhandler: C# ----------
    List<string> Msg;
    Count = c;
    Point3d PT = new Point3d(1, 1, 1);

    if(Run)
    {
      Msg = RecivedData(INmsg);
      if(Reset)
      {
        Static.Clear();
        c = -1;
        Msg.Clear();
      }

      List1 = LoadList(PTList);


      switch (Msg[0])
      {
        case "Add":
          Add(Msg[1]);
          break;
        case "Del":
          Del(Msg[1]);
          break;
        case "Res":
          Static.Clear();
          c = -1;
          break;
        default:
          Print("null message");
          Console.WriteLine("null message");
          break;
      }
    }

    NewList = List1;
    Static = List1;
# ---------- grassvrhandler: C# additional code ----------
  public int c;
  public static List<Point3d> Static;
  public bool hasStarted;
  public List<Point3d> List1 = new List<Point3d>();
  string[] ToRemove = new string[] {"{", "}"};

  List<string> RecivedData(string text)
  {
    if(text != null)
    {List<string> a = text.Split('\n').ToList();
      Console.WriteLine(0 + a[0] + 1 + a[1]);
      return a;}
    else
    {Console.WriteLine("Null");
      return new List<string>();}

  }
  List<Point3d> LoadList(List<Point3d> InList)
  {

    if (!hasStarted)
    {
      return InList;
    }
    else
    {
      if(Static.Count <= 0)
      {return InList;}
      else
      {return Static;}
    }
  }
  void Add(string Data)
  {
    Point3d Pt = Strg2Pt(Data);
    List1.Add(Pt);
  }
  void Del(string Data)
  {
    foreach (var c in ToRemove)
    {
      Data = Data.Replace(c, string.Empty);
    }
    int Index = Int32.Parse(Data);
    if(Index < List1.Count)
      List1.RemoveAt(Index);
    else
    {Print("Out of range Delete Index");
      Console.WriteLine("Out of range Delete Index");}
  }
  Point3d Strg2Pt(string String)
  {

    foreach (var c in ToRemove)
    {
      String = String.Replace(c, string.Empty);
    }
    string[] Splt = String.Split(',');
    float[] Position = {float.Parse(Splt[0]),
      float.Parse(Splt[1]),
      float.Parse(Splt[2])};
    return new Point3d(Position[0], Position[1], Position[2]);
  }


  /// <summary>
  /// This method will be called once every solution, before any calls to RunScript.
  /// </summary>
  public override void BeforeRunScript()
  {if (c <= 0)
      hasStarted = false;
    else
      hasStarted = true;
  }
  /// <summary>
  /// This method will be called once every solution, after any calls to RunScript.
  /// </summary>
  public override void AfterRunScript()
  {c++;}
# ---------- end grassvrhandler ----------
panel_8 = Panel(grassvrhandler.NewList)
panel_9 = Panel(grassvrhandler.Count)
panel_10 = Panel(grassvrhandler.out)

load = Load(Point=pt, ForceVector=Vector(0, 0, 1), Weighting=1)
panel_11 = Panel(load)
panel_12 = Panel(pt)
