# Grasshopper definition xyz-ident.gh (Grasshopper 1.0.7)
# plug-ins: gHowl

gradient = Gradient(
    LowerLimit=0,
    UpperLimit=1,
    stops=[0: RGB(12, 112, 215), 0: RGB(62, 216, 247), 0: RGB(0, 0, 255), 0: RGB(140, 108, 192), 0: RGB(207, 1, 65), 0: RGB(31, 203, 229), 0: RGB(183, 148, 117), 0: RGB(206, 88, 208), 0: RGB(7, 95, 26), 0: RGB(89, 38, 191)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])
geo = Geometry(<brep referenced from the Rhino model>)
panel = Panel(geo)
brep = Brep(geo)
line = Line(geo)
clean = CleanTree(RemoveNulls=True, RemoveInvalid=True, RemoveEmpty=False, Tree=brep)
pt = Point(geo)
end = EndPoints(Curve=pt)  # -> Start, End
brep_2 = Brep(brep)
pt_2 = Point([<point referenced from the Rhino model> x2])
panel_2 = Panel(pt_2)
tri = Triangulate(Mesh=brep_2)  # -> Mesh, Count
panel_3 = Panel(clean)
panel_4 = Panel(brep_2)
demesh = DeconstructMesh(Mesh=brep_2)  # -> Vertices, Faces, Colours, Normals
panel_5 = Panel(demesh.Faces)
panel_6 = Panel(demesh.Vertices)
panel_7 = Panel(demesh.Normals)
panel_8 = Panel([panel_6, panel_5])
panel_9 = Panel("5001")

timer = Timer(Interval=5, TimerInterval=5, Target=udp_2)  # disabled
udp = UDPReceiver(Address="127.0.0.1", Port="3000", Pattern="0")  # -> Info, Data
udp_2 = UDPSender(Address="127.0.0.1", Port="3000", Pattern="0")  # disabled
panel_10 = Panel(udp_2)
panel_11 = Panel(udp.Info)
panel_12 = Panel(udp.Data)

panel_13 = Panel("6000")

# ----
# UDP reciver
panel_14 = Panel("0")
udp_3 = UDPReceiver(Address="127.0.0.1", Port="5001", Pattern=panel_14)  # -> Info, Data; disabled

# ----
# UDP sender
panel_15 = Panel("5000")
timer_2 = Timer(Interval=1, TimerInterval=5, Target=udp_4)  # disabled
udp_4 = UDPSender(Address="127.0.0.1", Port=panel_15, Pattern="0", Data=panel_8)
