# Grasshopper definition FormFindingPlateExample.gh (Grasshopper 1.0.7)
# plug-ins: Kangaroo2 Components, gHowl, TextFileToScriptingComponent

filetoscript = FileToScript()

# ----
# Initial mesh geometry
number_slider = Slider(10, range=0..10)
mplane = MeshPlane(
    Boundary={Plane=PlaneXY(0, 0, 0), Size=Domain2(u=-10..10, v=-10..10)},
    WidthCount=Slider(10, range=-1..10),
    HeightCount=number_slider)  # -> Mesh, Area

# ----
# GrassVR
# control point handler
demesh = DeconstructMesh(Mesh=mplane.Mesh)  # -> Vertices, Faces, Colours, Normals
mc = MeshCorners(Mesh=mplane.Mesh, Angle=2.35619449)
grassvrhandler = CSharpScript(
    ModelPtList=demesh.Vertices,
    AnchorP=mc,
    AnchorS="10000",
    SupportZ=True,
    SnapR=Slider(0.2, range=0..2),
    RecPort="7001",
    Reference=["C:\Users\giaco\Documents\tesi\scripts\DataConvTry\DataConvTry\bin\Release\netcoreapp2.1\DataConvTry.dll", "C:\Users\giaco\Documents\tesi\DLL\System.Linq.dll", "C:\Users\giaco\Documents\tesi\scripts\Grasshopper\GaviVRPlugin\GaviVRPlugin\bin\GaviVRPlugin.gha"])  # -> AncP, AncT, AncS, Frame, X, Y, Z, XX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; inputs SupportX: list of Point3d, SupportY: String, SupportZ: Boolean, RecPort: Boolean
# ---------- grassvrhandler: C# usings ----------
using System.Linq;
# ---------- grassvrhandler: C# additional code ----------
  public int c;
  public static List<Point3d> Static;
  public bool hasStarted;
  public List<Point3d> List1 = new List<Point3d>();
  string[] ToRemove = new string[] {"{", "}"};

  List<string> RecivedData(string text)
  {
    if(text != null)
    {List<string> a = text.Split('\n').ToList();
      Console.WriteLine(0 + a[0] + 1 + a[1]);
      return a;}
    else
    {Console.WriteLine("Null");
      return new List<string>();}

  }
  List<Point3d> LoadList(List<Point3d> InList)
  {

    if (!hasStarted)
    {
      return InList;
    }
    else
    {
      if(Static.Count <= 0)
      {return InList;}
      else
      {return Static;}
    }
  }
  void Add(string Data)
  {
    Point3d Pt = Strg2Pt(Data);
    List1.Add(Pt);
  }
  void Del(string Data)
  {
    foreach (var c in ToRemove)
    {
      Data = Data.Replace(c, string.Empty);
    }
    int Index = Int32.Parse(Data);
    if(Index < List1.Count)
      List1.RemoveAt(Index);
    else
    {Print("Out of range Delete Index");
      Console.WriteLine("Out of range Delete Index");}
  }
  Point3d Strg2Pt(string String)
  {

    foreach (var c in ToRemove)
    {
      String = String.Replace(c, string.Empty);
    }
    string[] Splt = String.Split(',');
    float[] Position = {float.Parse(Splt[0]),
      float.Parse(Splt[1]),
      float.Parse(Splt[2])};
    return new Point3d(Position[0], Position[1], Position[2]);
  }


  /// <summary>
  /// This method will be called once every solution, before any calls to RunScript.
  /// </summary>
  public override void BeforeRunScript()
  {if (c <= 0)
      hasStarted = false;
    else
      hasStarted = true;
  }
  /// <summary>
  /// This method will be called once every solution, after any calls to RunScript.
  /// </summary>
  public override void AfterRunScript()
  {c++;}
# ---------- end grassvrhandler ----------

# ----
# Spring/line length goal
medges = MeshEdges(Mesh=mplane.Mesh)  # -> NakedEdges, InteriorEdges, NonManifoldEdges
merge = Merge(Data1=medges.NakedEdges, Data2=medges.InteriorEdges)
len = Length(Curve=merge)
multiplication = Multiplication(A=len, B=Slider(0.82, range=0..1))
length_line = LengthLine(Line=merge, Length=multiplication, Strength=Slider(1.17, range=0..10))

# ----
# Mesh Load Goal
number_slider_2 = Slider(0.14, range=0..10)
vertexloads = VertexLoads(Mesh=mplane.Mesh, Strength=number_slider_2)  # -> flatten(L)

# ----
# Anchor Goals
anchor = Anchor(Point=[mc, grassvrhandler.AncP], Target=[mc, grassvrhandler.AncT], Strength=["10000", grassvrhandler.AncS])

# ----
# Load Goals
load = Load(Point=grassvrhandler.LP, ForceVector=grassvrhandler.LV, Weighting=grassvrhandler.LW)  # -> flatten(Unary)

# ----
# Support Goals
support = Support(
    Frame=grassvrhandler.Frame,
    X=grassvrhandler.X,
    Y=grassvrhandler.Y,
    Z=grassvrhandler.Z,
    XX=grassvrhandler.XX,
    YY=grassvrhandler.YY,
    ZZ=grassvrhandler.ZZ,
    Strength=grassvrhandler.SupS)

grab = Grab(On=True, Strength=1, Range=1)
show = Show(G=mplane.Mesh)
clean = CleanTree(RemoveNulls=True, RemoveInvalid=True, RemoveEmpty=False, Tree=[support, load, vertexloads, anchor])

# ----
# Initial mesh
demesh_2 = DeconstructMesh(Mesh=mplane.Mesh)  # -> Vertices, Faces, Colours, Normals
panel = Panel([demesh_2.Faces, demesh_2.Vertices])
timer = Timer(Interval=1, TimerInterval=5, Target=udp)  # disabled
udp = UDPSender(Address="127.0.0.1", Port="10000", Pattern="0", Data=panel)

# ----
# UDP receiver
panel_2 = Panel("0")
udp_2 = UDPReceiver(Address="127.0.0.1", Port="5001", Pattern=panel_2)  # -> Info, Data; disabled

cp = ControlPoints()  # -> Points, Weights, Knots

# ----
# ShearLine
panel_3 = Panel(cp.Points)
timer_2 = Timer(Interval=1, TimerInterval=5, Target=udp_3)  # disabled
udp_3 = UDPSender(Address="127.0.0.1", Port="5000", Pattern="0", Data=panel_3)

# ----
# Only the mesh data need to be exported
# {0,0} = Mesh (Show goal)
# {0,1} = Goals
entwine = Entwine(Branch00=show, Branch01=[clean, grab, length_line], FlattenInputs=True)

# ----
# Kangaroo Solver
button = Button()
solver = Solver(GoalObjects=entwine, Reset=button, Threshold=1e-15, Tolerance=0.01, On=Toggle(True))  # -> I, V, O

bang = ExplodeTree(Data=solver.O)  # -> Branch0, Branch1

mesh = Mesh(bang.Branch0)

# ----
# Deformed mesh
demesh_3 = DeconstructMesh(Mesh=mesh)  # -> Vertices, Faces, Colours, Normals
panel_4 = Panel([demesh_3.Faces, demesh_3.Vertices])
timer_3 = Timer(Interval=1, TimerInterval=5, Target=udp_4)  # disabled
udp_4 = UDPSender(Address="127.0.0.1", Port="5000", Pattern="0", Data=panel_4)
