# Grasshopper definition BeamExample1-mine.gh (Grasshopper 1.0.7)
# plug-ins: Kangaroo2 Components

# Initial geometry
C = Curve([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])
number_slider = Slider(0.001, range=0.001..4)

# ----
# Load Goals
Y = UnitY(Factor=1)
Y_2 = UnitY(Factor=-1)
unit = UnitVector(Vector=Y)
pt = Point([Point(5, 5, 20), Point(30, 5, 20)])
load = Load(Point=pt, ForceVector=[Y_2, Y], Weighting=[Slider(0.06, range=0..0.5), Slider(0.14, range=0..0.5)])
panel = Panel(load)

# ----
# Anchor Goals
pt_2 = Point(Point(30, 5, 0))
pt_3 = Point(Point(5, 5, 0))
xy = XYPlane(Origin=[pt_2, pt_3])
toggle = BooleanToggle(True)
toggle_2 = BooleanToggle(True)
support = Support(
    Frame=[pt_3, pt_2],
    X=[toggle_2, toggle],
    Y=[toggle_2, toggle],
    Z=toggle_2,
    XX=toggle_2,
    YY=toggle_2,
    ZZ=toggle_2,
    Strength=100)
panel_2 = Panel(support)

grab = Grab(On=True, Strength=1, Range=1)

# ----
# Kangaroo Slver tester for custom iterations
button = Button()
customiteration = CSharpScript(Reset=Button(), Step=button, Reference="C:\Program Files\Rhino 7 WIP\Plug-ins\Grasshopper\Components\KangarooSolver.dll")  # -> out, A, B, C, D, E, F; inputs Goals: list, Reset: Boolean, Step: Boolean
# ---------- customiteration: C# ----------
    if(Reset)
    {
      PS = new KangarooSolver.PhysicalSystem();
      counter = 0;
      GoalList.Clear();
      foreach(IGoal G in Goals) //Assign indexes to the particles in each Goal:
      {
        PS.AssignPIndex(G, 0.0001); // the second argument is the tolerance distance below which points combine into a single particle
        GoalList.Add(G);
      }
    }
    if(Step)
    {
      PS.SimpleStep(GoalList);
      counter++;
    }


    A = PS.GetOutput(GoalList);
    B = counter;
    C = PS.GetAllMoves(GoalList);
    D = PS.GetAllWeightings(GoalList);
    E = PS.GetPositionArray();

    var Names = new List<String>[PS.ParticleCount()];

    for(int i = 0; i < PS.ParticleCount();i++)
    {
      Names[i] = new List<String>();
    }

    for(int i = 0;i < GoalList.Count;i++)
    {
      var FullName = GoalList[i].ToString();
      Char splitter = '.';
      var Name = FullName.Split(splitter);
      var G = GoalList[i] as IGoal;

      for(int j = 0; j < G.PIndex.Count();j++)
      {
        Names[G.PIndex[j]].Add(Name[2]);
      }
    }


    F = Names;
# ---------- customiteration: C# additional code ----------
  KangarooSolver.PhysicalSystem PS = new KangarooSolver.PhysicalSystem();
  List<IGoal> GoalList = new List<IGoal>();
  int counter = 0;
# ---------- end customiteration ----------
clean = CleanTree(RemoveNulls=True, RemoveInvalid=True, RemoveEmpty=False, Tree=customiteration.A)
panel_3 = Panel(customiteration.B)
c_script = CSharpScript(x=customiteration.F)  # -> A
# ---------- c_script: C# ----------
    A = x as List<string>;
# ---------- end c_script ----------
c_script_2 = CSharpScript(x=customiteration.D)  # -> A
# ---------- c_script_2: C# ----------
    A = x as List<double>;
# ---------- end c_script_2 ----------
c_script_3 = CSharpScript(x=customiteration.C)  # -> A
# ---------- c_script_3: C# ----------
    A = x as List<Vector3d>;
# ---------- end c_script_3 ----------
concat = Concatenate(FragmentA=c_script, FragmentC="  ", FragmentB=c_script_2)
addition = Addition(A=graft(customiteration.E), B=c_script_3)
vdis = VectorDisplay(Anchor=graft(customiteration.E), Vector=c_script_3)
tag = TextTag(Location=addition, Text=concat)

# ----
# Nurb2point test for line renderer
crv = Curve([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])
cp = ControlPoints(Curve=graft(crv))  # -> Points, Weights, Knots
panel_4 = Panel(cp.Knots)
panel_5 = Panel(cp.Weights)
crv_2 = Curve([<curve referenced from the Rhino model> x2])
cpoly = ControlPolygon(Curve=crv)  # -> Polygon, Points
cp_2 = ControlPoints(Curve=crv_2)  # -> Points, Weights, Knots
dedom2 = DeconstructDomain²(Domain=crv_2)  # -> UComponent, VComponent
panel_6 = Panel(cp.Points)
crv_cp = CurveClosestPoint()  # -> Point, Parameter, Distance

# ----
# Lines to beam frame
divlength = DivideLength(Curve=C, Length=2.5)  # -> Points, Tangents, Parameters
pline = PolyLine(Vertices=divlength.Points, Closed=False)
explode = Explode(Curve=pline, Recursive=True)  # -> Segments, Vertices
pframe = PerpFrame(Curve=reparameterize(explode.Segments), Parameter=1)
pframe_2 = PerpFrame(Curve=reparameterize(explode.Segments), Parameter=0)

panel_7 = Panel(explode.Vertices)

# ----
# Custom Goals Test
number_slider_2 = Slider(100, range=0.1..100)
pt_4 = Point([Point(30, 5, 0), Point(5, 5, 0)])
vranchor = CSharpScript(
    FullPtList=flatten(explode.Vertices),
    BaseP=pt_4,
    TargetP=pt_4,
    k=1000,
    R=number_slider_2,
    Reference="C:\Program Files\Rhino 7 WIP\Plug-ins\Grasshopper\Components\KangarooSolver.dll")  # -> out, A; inputs FullPtList: list of Point3d, BaseP: Point3d, TargetP: Point3d, k: Double, R: Double
# ---------- vranchor: C# usings ----------
using System.IO;
using System.Linq;
using System.Data;
using System.Drawing;
using System.Reflection;
using System.Windows.Forms;
using System.Xml;
using System.Xml.Linq;
using System.Runtime.InteropServices;

using Rhino.DocObjects;
using Rhino.Collections;
using GH_IO;
using GH_IO.Serialization;
using KPlankton;
using KangarooSolver;
using KangarooSolver.Goals;
# ---------- vranchor: C# ----------
    Point3d Pt;
    Pt = FindPt(BaseP, FullPtList, R);
    if(BaseP == TargetP)
      TargetP = Pt;
    A = new GrassVRAnchor(Pt, TargetP, k); //create an instance of your custom goal
# ---------- vranchor: C# additional code ----------
  public Point3d FindPt(Point3d BaseP, List<Point3d> FullPtList, double R)
  {
    double Range = R * R;
    double[] SqrDist = new double[FullPtList.Count];

    for (int i = 0; i < FullPtList.Count; i++)
    {
      SqrDist[i] = (BaseP - FullPtList[i]).SquareLength;

    }
    int Index = Array.IndexOf(SqrDist, SqrDist.Min());
    return FullPtList[Index];
  }

  public class GrassVRAnchor : GoalObject
  {
    public double Strength;
    public Point3d Pt;
    public Point3d InsPt,OriginalP;
    public double Range;
    public bool BaseEqTarg = false;


    /// <summary>
    /// Construct a new Anchor object by particle index and target position
    /// </summary>
    /// <param name="Id">The integer index of the particle to anchor.</param>
    /// <param name="P">The target position to keep the particle at.</param>
    /// <param name="K">Strength of the Anchor. For an absolute anchor, you can use double.MaxValue here.</param>
    public GrassVRAnchor(Point3d BaseP, Point3d P, double k)
    {

      PPos = new Point3d[1] { P };
      Move = new Vector3d[1];
      Weighting = new double[1] { k };
      Strength = k;

      // if(BaseP == P) BaseEqTarg = true;
      Pt = P;
      InsPt = BaseP;
      //PPos = new Point3d[1] { BaseP };
    }

    public override void Calculate(List<KangarooSolver.Particle> p)
    {
      Move[0] = Pt - p[PIndex[0]].Position;
      Weighting[0] = Strength;
    }

  }
# ---------- end vranchor ----------
panel_8 = Panel(vranchor.out)
panel_9 = Panel(vranchor.A)

# ----
# Kangaroo Solver
button_2 = Button()

# ----
# Deformed Mesh Section
number_slider_3 = Slider(0.25, range=0..1)
number_slider_4 = Slider(0.15, range=0..1)

multiplication = Multiplication(A=number_slider_3, B=number_slider_4)
multiplication_2 = Multiplication(A=multiplication, B="100")

beam = Beam(StartFrame=pframe_2, EndFrame=pframe, E="100", A=multiplication_2, Ix=number_slider, Iy=number_slider, GJ=number_slider)

# ----
# Only beam data to the solvers
# {0,0} = Model
# {0,1} = Goals
entwine = Entwine(Branch00=beam, Branch01=[vranchor.A, grab], FlattenInputs=True)

solver = Solver(GoalObjects=entwine, Reset=button_2, Threshold=1e-15, Tolerance=0.01, On=Toggle(True))  # -> I, V, O

bang = ExplodeTree(Data=solver.O)  # -> Branch0, Branch1

kangarooresultsconv = CSharpScript(x=graft(bang.Branch0))  # -> out, P0, P1, TX1, TX2, TY1, TY2, Twist
# ---------- kangarooresultsconv: C# ----------
    List<object> data = x as List<object>;
    P0 = data[0];
    P1 = data[1];
    TX1 = data[2];
    TX2 = data[3];
    TY1 = data[4];
    TY2 = data[5];
    Twist = data[6];
# ---------- end kangarooresultsconv ----------
shear2mesh = CSharpScript(
    P0=kangarooresultsconv.P0,
    P1=kangarooresultsconv.P1,
    Twist=kangarooresultsconv.Twist,
    scale=Slider(286.578, range=0..500))  # -> out, flatten(T); inputs Twist: Double, scale: Double
# ---------- shear2mesh: C# usings ----------
using System.IO;
using System.Linq;
using System.Data;
using System.Drawing;
using System.Reflection;
using System.Windows.Forms;
using System.Xml;
using System.Xml.Linq;
using System.Runtime.InteropServices;

using Rhino.DocObjects;
using Rhino.Collections;
using GH_IO;
using GH_IO.Serialization;
# ---------- shear2mesh: C# ----------
    Plane PA = (Plane) P0;
    Plane PB = (Plane) P1;

    Vector3d axis = PB.Origin - PA.Origin;
    int sense = 1;
    if(Twist > 0)
    {
      axis.Reverse();
      PA = PB;
      sense = -1;
    }
    T = Rhino.Geometry.NurbsCurve.CreateSpiral(PA.Origin, axis, PA.PointAt(0, sense), axis.Length, sense, scale * Twist, scale * Twist);
# ---------- end shear2mesh ----------
line2mesh = CSharpScript(P0=kangarooresultsconv.P0, P1=kangarooresultsconv.P1, x=number_slider_3, y=number_slider_4)  # -> out, flatten(M); inputs x: Double, y: Double
# ---------- line2mesh: C# ----------
    Plane PA = (Plane) P0;
    Plane PB = (Plane) P1;

    Mesh M1 = new Mesh();

    Point3d[] Verts = new Point3d[8]{
      PA.PointAt(x, y),PA.PointAt(-x, y),PA.PointAt(-x, -y),PA.PointAt(x, -y),
      PB.PointAt(x, y),PB.PointAt(-x, y),PB.PointAt(-x, -y),PB.PointAt(x, -y)};
    M1.Vertices.AddVertices(Verts);

    M1.Faces.AddFace(1, 5, 4, 0);
    M1.Faces.AddFace(2, 6, 5, 1);
    M1.Faces.AddFace(3, 7, 6, 2);
    M1.Faces.AddFace(0, 4, 7, 3);

    M = M1;
# ---------- end line2mesh ----------
moment2mesh = CSharpScript(
    P0=kangarooresultsconv.P0,
    P1=kangarooresultsconv.P1,
    x1=kangarooresultsconv.TX1,
    x2=kangarooresultsconv.TX2,
    y1=kangarooresultsconv.TY1,
    y2=kangarooresultsconv.TY2,
    scale=Slider(74.467, range=0..101))  # -> out, flatten(MX), flatten(MY); inputs x1: Double, x2: Double, y1: Double, y2: Double, scale: Double
# ---------- moment2mesh: C# ----------
    Plane PA = (Plane) P0;
    Plane PB = (Plane) P1;

    Mesh M0 = new Mesh();
    Point3d[] Verts = new Point3d[4]{
      PA.Origin,
      PA.PointAt(0, -x1 * scale),
      PB.PointAt(0, x2 * scale),
      PB.Origin};

    M0.Vertices.AddVertices(Verts);
    M0.Faces.AddFace(0, 1, 2, 3);

    Mesh M1 = new Mesh();
    Verts = new Point3d[4]{
      PA.Origin,
      PA.PointAt(-y1 * scale, 0),
      PB.PointAt(y2 * scale, 0),
      PB.Origin};

    M1.Vertices.AddVertices(Verts);
    M1.Faces.AddFace(0, 1, 2, 3);

    MX = M0;
    MY = M1;
# ---------- end moment2mesh ----------
preview = CustomPreview(
    Geometry=shear2mesh.T,
    Shader={diffuse=RGB(0, 255, 0), emission=RGB(0, 255, 0), shine=0, specular=RGB(255, 255, 255), transparency=0})
preview_2 = CustomPreview(
    Geometry=moment2mesh.MX,
    Shader={diffuse=RGB(255, 0, 0), emission=RGB(255, 0, 0), shine=0, specular=RGB(255, 255, 255), transparency=0})
preview_3 = CustomPreview(
    Geometry=moment2mesh.MY,
    Shader={diffuse=RGB(0, 0, 255), emission=RGB(0, 0, 255), shine=0, specular=RGB(255, 255, 255), transparency=0})
preview_4 = CustomPreview(
    Geometry=line2mesh.M,
    Shader={diffuse=RGB(0, 128, 128), emission=RGB(0, 0, 0), shine=0, specular=RGB(255, 255, 255), transparency=0})
