# Grasshopper definition FormFindingBeamExample.gh (Grasshopper 1.0.7)
# plug-ins: Kangaroo2 Components, gHowl

# Initial geometry
C = Curve([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])

# ----
# Support Goals
pt = Point(Point(5, 5, 0))
toggle = BooleanToggle(True)
toggle_2 = BooleanToggle(True)
support = Support(Frame=pt, X=[toggle_2, toggle], Y=[toggle_2, toggle], Z=toggle_2, XX=toggle_2, YY=toggle_2, ZZ=toggle_2, Strength=100)

# ----
# Load Goals
number_slider = Slider(0.14, range=0..0.5)
Y = UnitY(Factor=-1)
Y_2 = UnitY(Factor=1)
pt_2 = Point([Point(5, 5, 20), Point(30, 5, 20)])
load = Load(Point=pt_2, ForceVector=[Y, Y_2], Weighting=[Slider(0.22, range=0..0.5), number_slider])

pt_3 = Point(Point(0, 0, 0))
number_slider_2 = Slider(1.218, range=0.001..4)

# ----
# Anchor Goals
anchor = Anchor(Point=pt_3, Strength=10000)

grab = Grab(On=True, Strength=1, Range=1)

# ----
# UDP reciver
panel = Panel("0")
udp = UDPReceiver(Address="127.0.0.1", Port="5001", Pattern=panel)  # -> Info, Data; disabled

# ----
# Lines to beam frame
divlength = DivideLength(Curve=C, Length=2.5)  # -> Points, Tangents, Parameters
pline = PolyLine(Vertices=divlength.Points, Closed=False)
explode = Explode(Curve=pline, Recursive=True)  # -> Segments, Vertices
pframe = PerpFrame(Curve=reparameterize(explode.Segments), Parameter=1)
pframe_2 = PerpFrame(Curve=reparameterize(explode.Segments), Parameter=0)

# ----
# Kangaroo Solver
button = Button()

# ----
# Deformed Mesh Section
number_slider_3 = Slider(0.25, range=0..1)
number_slider_4 = Slider(0.15, range=0..1)

multiplication = Multiplication(A=number_slider_3, B=number_slider_4)
multiplication_2 = Multiplication(A=multiplication, B="100")

beam = Beam(
    StartFrame=pframe_2,
    EndFrame=pframe,
    E="100",
    A=multiplication_2,
    Ix=number_slider_2,
    Iy=number_slider_2,
    GJ=number_slider_2)

# ----
# Only beam data to the solvers
# {0,0} = Model
# {0,1} = Goals
entwine = Entwine(Branch00=beam, Branch01=[grab, support, load, anchor], FlattenInputs=True)

solver = Solver(GoalObjects=entwine, Reset=button, Threshold=1e-15, Tolerance=0.01, On=Toggle(True))  # -> I, V, O

bang = ExplodeTree(Data=solver.O)  # -> Branch0, Branch1

kangarooresultsconv = CSharpScript(x=graft(bang.Branch0))  # -> out, P0, P1, TX1, TX2, TY1, TY2, Twist
# ---------- kangarooresultsconv: C# ----------
    List<object> data = x as List<object>;
    P0 = data[0];
    P1 = data[1];
    TX1 = data[2];
    TX2 = data[3];
    TY1 = data[4];
    TY2 = data[5];
    Twist = data[6];
# ---------- end kangarooresultsconv ----------
shear2mesh = CSharpScript(
    P0=kangarooresultsconv.P0,
    P1=kangarooresultsconv.P1,
    Twist=kangarooresultsconv.Twist,
    scale=Slider(286.578, range=0..500))  # -> out, flatten(T); inputs Twist: Double, scale: Double
# ---------- shear2mesh: C# usings ----------
using System.IO;
using System.Linq;
using System.Data;
using System.Drawing;
using System.Reflection;
using System.Windows.Forms;
using System.Xml;
using System.Xml.Linq;
using System.Runtime.InteropServices;

using Rhino.DocObjects;
using Rhino.Collections;
using GH_IO;
using GH_IO.Serialization;
# ---------- shear2mesh: C# ----------
    Plane PA = (Plane) P0;
    Plane PB = (Plane) P1;

    Vector3d axis = PB.Origin - PA.Origin;
    int sense = 1;
    if(Twist > 0)
    {
      axis.Reverse();
      PA = PB;
      sense = -1;
    }
    T = Rhino.Geometry.NurbsCurve.CreateSpiral(PA.Origin, axis, PA.PointAt(0, sense), axis.Length, sense, scale * Twist, scale * Twist);
# ---------- end shear2mesh ----------
line2mesh = CSharpScript(P0=kangarooresultsconv.P0, P1=kangarooresultsconv.P1, x=number_slider_3, y=number_slider_4)  # -> out, flatten(M); inputs x: Double, y: Double
# ---------- line2mesh: C# ----------
    Plane PA = (Plane) P0;
    Plane PB = (Plane) P1;

    Mesh M1 = new Mesh();

    Point3d[] Verts = new Point3d[8]{
      PA.PointAt(x, y),PA.PointAt(-x, y),PA.PointAt(-x, -y),PA.PointAt(x, -y),
      PB.PointAt(x, y),PB.PointAt(-x, y),PB.PointAt(-x, -y),PB.PointAt(x, -y)};
    M1.Vertices.AddVertices(Verts);

    M1.Faces.AddFace(1, 5, 4, 0);
    M1.Faces.AddFace(2, 6, 5, 1);
    M1.Faces.AddFace(3, 7, 6, 2);
    M1.Faces.AddFace(0, 4, 7, 3);

    M = M1;
# ---------- end line2mesh ----------
moment2mesh = CSharpScript(
    P0=kangarooresultsconv.P0,
    P1=kangarooresultsconv.P1,
    x1=kangarooresultsconv.TX1,
    x2=kangarooresultsconv.TX2,
    y1=kangarooresultsconv.TY1,
    y2=kangarooresultsconv.TY2,
    scale=Slider(74.467, range=0..101))  # -> out, flatten(MX), flatten(MY); inputs x1: Double, x2: Double, y1: Double, y2: Double, scale: Double
# ---------- moment2mesh: C# ----------
    Plane PA = (Plane) P0;
    Plane PB = (Plane) P1;

    Mesh M0 = new Mesh();
    Point3d[] Verts = new Point3d[4]{
      PA.Origin,
      PA.PointAt(0, -x1 * scale),
      PB.PointAt(0, x2 * scale),
      PB.Origin};

    M0.Vertices.AddVertices(Verts);
    M0.Faces.AddFace(0, 1, 2, 3);

    Mesh M1 = new Mesh();
    Verts = new Point3d[4]{
      PA.Origin,
      PA.PointAt(-y1 * scale, 0),
      PB.PointAt(y2 * scale, 0),
      PB.Origin};

    M1.Vertices.AddVertices(Verts);
    M1.Faces.AddFace(0, 1, 2, 3);

    MX = M0;
    MY = M1;
# ---------- end moment2mesh ----------
preview = CustomPreview(
    Geometry=shear2mesh.T,
    Shader={diffuse=RGB(0, 255, 0), emission=RGB(0, 255, 0), shine=0, specular=RGB(255, 255, 255), transparency=0})
preview_2 = CustomPreview(
    Geometry=moment2mesh.MX,
    Shader={diffuse=RGB(255, 0, 0), emission=RGB(255, 0, 0), shine=0, specular=RGB(255, 255, 255), transparency=0})
preview_3 = CustomPreview(
    Geometry=moment2mesh.MY,
    Shader={diffuse=RGB(0, 0, 255), emission=RGB(0, 0, 255), shine=0, specular=RGB(255, 255, 255), transparency=0})
preview_4 = CustomPreview(
    Geometry=line2mesh.M,
    Shader={diffuse=RGB(0, 128, 128), emission=RGB(0, 0, 0), shine=0, specular=RGB(255, 255, 255), transparency=0})

cp = ControlPoints(Curve=graft(shear2mesh.T))  # -> Points, Weights, Knots

# ----
# DeformedMesh
panel_2 = Panel(line2mesh.M)
timer = Timer(Interval=1, TimerInterval=5, Target=udp_2)  # disabled
udp_2 = UDPSender(Address="127.0.0.1", Port="5000", Pattern="0", Data=panel_2)

# ----
# ShearLine
panel_3 = Panel(cp.Points)
timer_2 = Timer(Interval=1, TimerInterval=5, Target=udp_3)  # disabled
udp_3 = UDPSender(Address="127.0.0.1", Port="5000", Pattern="0", Data=panel_3)

# ----
# MeshMX
panel_4 = Panel(moment2mesh.MX)
timer_3 = Timer(Interval=1, TimerInterval=5, Target=udp_4)  # disabled
udp_4 = UDPSender(Address="127.0.0.1", Port="5000", Pattern="0", Data=panel_4)

# ----
# MeshMY
panel_5 = Panel(moment2mesh.MY)
timer_4 = Timer(Interval=1, TimerInterval=5, Target=udp_5)  # disabled
udp_5 = UDPSender(Address="127.0.0.1", Port="5000", Pattern="0", Data=panel_5)
