# Grasshopper definition BeamExample1-mine.gh (Grasshopper 1.0.7)
# plug-ins: Kangaroo2 Components

C = Curve([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])
divlength = DivideLength(Curve=C, Length=2.5)  # -> Points, Tangents, Parameters
pline = PolyLine(Vertices=divlength.Points, Closed=False)
Y = UnitY(Factor=-1)
pt = Point(Point(17.5, 15, 20))
explode = Explode(Curve=pline, Recursive=True)  # -> Segments, Vertices
panel = Panel(explode.Vertices)
pt_2 = Point(Point(30, 5, 0))
pt_3 = Point(Point(5, 5, 0))
load = Load(Point=pt, ForceVector=Y, Weighting=Slider(0.008442, range=0..0.01))
number_slider = Slider(4, range=0.001..4)
pframe = PerpFrame(Curve=reparameterize(explode.Segments), Parameter=1)
pframe_2 = PerpFrame(Curve=reparameterize(explode.Segments), Parameter=0)
xy = XYPlane(Origin=pt_2)
xy_2 = XYPlane(Origin=pt_3)
support = Support(
    Frame=xy,
    X=Toggle(True),
    Y=Toggle(True),
    Z=Toggle(True),
    XX=Toggle(True),
    YY=Toggle(True),
    ZZ=Toggle(True),
    Strength=100)
support_2 = Support(
    Frame=xy_2,
    X=Toggle(True),
    Y=Toggle(True),
    Z=Toggle(True),
    XX=Toggle(True),
    YY=Toggle(True),
    ZZ=Toggle(True),
    Strength=100)
grab = Grab(On=True, Strength=1, Range=1)
panel_2 = Panel(support)
number_slider_2 = Slider(0.136, range=0..1)
number_slider_3 = Slider(0.114, range=0..1)
multiplication = Multiplication(A=number_slider_2, B=number_slider_3)
multiplication_2 = Multiplication(A=multiplication, B="1000")
beam = Beam(StartFrame=pframe_2, EndFrame=pframe, E="10", A=multiplication_2, Ix=number_slider, Iy=number_slider, GJ=1)
entwine = Entwine(Branch00=beam, Branch01=[support, support_2, grab, load], FlattenInputs=True)
solver = Solver(GoalObjects=entwine, Reset=Button(), Threshold=1e-15, Tolerance=0.01, On=Toggle(True))  # -> I, V, O
viewer = ParamViewer(solver.O)
bang = ExplodeTree(Data=solver.O)  # -> Branch0, Branch1
c_script = CSharpScript(x=graft(bang.Branch0))  # -> out, P0, P1, TX1, TX2, TY1, TY2, Twist
# ---------- c_script: C# ----------
    List<object> data = x as List<object>;
    P0 = data[0];
    P1 = data[1];
    TX1 = data[2];
    TX2 = data[3];
    TY1 = data[4];
    TY2 = data[5];
    Twist = data[6];
# ---------- end c_script ----------
c_script_2 = CSharpScript(
    P0=c_script.P0,
    P1=c_script.P1,
    x1=c_script.TX1,
    x2=c_script.TX2,
    y1=c_script.TY1,
    y2=c_script.TY2,
    scale=Slider(50.843, range=0..101))  # -> out, MX, MY; inputs x1: Double, x2: Double, y1: Double, y2: Double, scale: Double
# ---------- c_script_2: C# ----------
    Plane PA = (Plane) P0;
    Plane PB = (Plane) P1;

    Mesh M0 = new Mesh();
    Point3d[] Verts = new Point3d[4]{
      PA.Origin,
      PA.PointAt(0, -x1 * scale),
      PB.PointAt(0, x2 * scale),
      PB.Origin};

    M0.Vertices.AddVertices(Verts);
    M0.Faces.AddFace(0, 1, 2, 3);

    Mesh M1 = new Mesh();
    Verts = new Point3d[4]{
      PA.Origin,
      PA.PointAt(-y1 * scale, 0),
      PB.PointAt(y2 * scale, 0),
      PB.Origin};

    M1.Vertices.AddVertices(Verts);
    M1.Faces.AddFace(0, 1, 2, 3);

    MX = M0;
    MY = M1;
# ---------- end c_script_2 ----------
c_script_3 = CSharpScript(P0=c_script.P0, P1=c_script.P1, x=number_slider_2, y=number_slider_3)  # -> out, M; inputs x: Double, y: Double
# ---------- c_script_3: C# ----------
    Plane PA = (Plane) P0;
    Plane PB = (Plane) P1;

    Mesh M1 = new Mesh();

    Point3d[] Verts = new Point3d[8]{
      PA.PointAt(x, y),PA.PointAt(-x, y),PA.PointAt(-x, -y),PA.PointAt(x, -y),
      PB.PointAt(x, y),PB.PointAt(-x, y),PB.PointAt(-x, -y),PB.PointAt(x, -y)};
    M1.Vertices.AddVertices(Verts);

    M1.Faces.AddFace(1, 5, 4, 0);
    M1.Faces.AddFace(2, 6, 5, 1);
    M1.Faces.AddFace(3, 7, 6, 2);
    M1.Faces.AddFace(0, 4, 7, 3);

    M = M1;
# ---------- end c_script_3 ----------
c_script_4 = CSharpScript(P0=c_script.P0, P1=c_script.P1, Twist=c_script.Twist, scale=Slider(36.099, range=0..500))  # -> out, T; inputs Twist: Double, scale: Double
# ---------- c_script_4: C# usings ----------
using System.IO;
using System.Linq;
using System.Data;
using System.Drawing;
using System.Reflection;
using System.Windows.Forms;
using System.Xml;
using System.Xml.Linq;
using System.Runtime.InteropServices;

using Rhino.DocObjects;
using Rhino.Collections;
using GH_IO;
using GH_IO.Serialization;
# ---------- c_script_4: C# ----------
    Plane PA = (Plane) P0;
    Plane PB = (Plane) P1;

    Vector3d axis = PB.Origin - PA.Origin;
    int sense = 1;
    if(Twist > 0)
    {
      axis.Reverse();
      PA = PB;
      sense = -1;
    }
    T = Rhino.Geometry.NurbsCurve.CreateSpiral(PA.Origin, axis, PA.PointAt(0, sense), axis.Length, sense, scale * Twist, scale * Twist);
# ---------- end c_script_4 ----------
preview = CustomPreview(
    Geometry=c_script_3.M,
    Shader={diffuse=RGB(0, 128, 128), emission=RGB(0, 0, 0), shine=0, specular=RGB(255, 255, 255), transparency=0})
preview_2 = CustomPreview(
    Geometry=c_script_2.MY,
    Shader={diffuse=RGB(0, 0, 255), emission=RGB(0, 0, 255), shine=0, specular=RGB(255, 255, 255), transparency=0})
preview_3 = CustomPreview(
    Geometry=c_script_4.T,
    Shader={diffuse=RGB(0, 255, 0), emission=RGB(0, 255, 0), shine=0, specular=RGB(255, 255, 255), transparency=0})
preview_4 = CustomPreview(
    Geometry=c_script_2.MX,
    Shader={diffuse=RGB(255, 0, 0), emission=RGB(255, 0, 0), shine=0, specular=RGB(255, 255, 255), transparency=0})
