# Grasshopper definition sculpt_example.gh (Grasshopper 1.0.7)
# plug-ins: Kangaroo2 Components

mesh = Mesh(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)
medges = MeshEdges(Mesh=mesh)  # -> NakedEdges, InteriorEdges, NonManifoldEdges
mesh_2 = Mesh(mesh)
join = JoinCurves(Curves=medges.NakedEdges, Preserve=False)
faceb = FaceBoundaries(Mesh=mesh_2)
explode = Explode(Curve=join, Recursive=True)  # -> Segments, Vertices
demesh = DeconstructMesh(Mesh=mesh_2)  # -> Vertices, Faces, Colours, Normals
medges_2 = MeshEdges(Mesh=mesh_2)  # -> NakedEdges, InteriorEdges, NonManifoldEdges
explode_2 = Explode(Curve=faceb, Recursive=True)  # -> Segments, Vertices
shift = ShiftList(List=explode.Segments, Shift=1, Wrap=True)
# Plastic anchors have a memory. If you need to reset this, one easy way is to select your entire Grasshopper definition using Ctrl-A, then cut and paste it back with Ctrl-X, Ctrl-V
plasticanchor = PlasticAnchor(Point=demesh.Vertices, Limit=0.05, Strength=3)
clamplength = ClampLength(Line=medges_2.InteriorEdges, LowerLimit=1, UpperLimit=4, Strength=5)
equallength = EqualLength(Line=explode_2.Segments, Strength=2)
smooth = Smooth(M=mesh_2, Strength=8)
show = Show(G=mesh_2)
angle = Angle(LineA=explode.Segments, LineB=shift, RestAngle=0, Strength=50)
equallength_2 = EqualLength(Line=explode.Segments, Strength=3)
grab = Grab(On=True, Strength=1, Range=3)
solver = Solver(
    GoalObjects=[plasticanchor, smooth, show, equallength, clamplength, equallength_2, angle, grab],
    Reset=Button(),
    Threshold=1e-15,
    Tolerance=0.01,
    On=True)  # -> I, V, O
preview = CustomPreview(
    Geometry=solver.O,
    Shader={diffuse=RGB(71, 222, 11), emission=RGB(0, 24, 0), shine=0.8, specular=RGB(255, 255, 255), transparency=0})
