# Grasshopper definition CustomGoal.gh (Grasshopper 1.0.7)
# plug-ins: Kangaroo2 Components

pop3d = Populate3D(Region={Plane=PlaneXY(0, 0, 0), X=Domain(0, 10), Y=Domain(0, 10), Z=Domain(0, 2)}, Count=100, Seed=1)
brep = Brep(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)
pt = Point(Point(4.760594643, 11.56574887, 0.6287550079))
pt_2 = Point(Point(1.35418664, 11.89329136, -0.3057427154))
onsurf = CSharpScript(
    BaseP=pt,
    TargetP=pt,
    k=1000,
    R=5,
    Reference="C:\Program Files\Rhino 7 WIP\Plug-ins\Grasshopper\Components\KangarooSolver.dll")  # -> out, A; inputs BaseP: Point3d, TargetP: Point3d, k: Double, R: Double
# ---------- onsurf: C# usings ----------
using System.IO;
using System.Linq;
using System.Data;
using System.Drawing;
using System.Reflection;
using System.Windows.Forms;
using System.Xml;
using System.Xml.Linq;
using System.Runtime.InteropServices;

using Rhino.DocObjects;
using Rhino.Collections;
using GH_IO;
using GH_IO.Serialization;
using KPlankton;
using KangarooSolver;
using KangarooSolver.Goals;
# ---------- onsurf: C# ----------
    A = new GrassVRAnchor(BaseP, TargetP, k, R); //create an instance of your custom goal
# ---------- onsurf: C# additional code ----------
  public class GrassVRAnchor : GoalObject
  {
    public double Strength;
    public Point3d Pt;
    public Point3d InsPt;
    public double Range;

    public GrassVRAnchor()
    {
    }

    /// <summary>
    /// Construct a new Anchor object by particle index and target position
    /// </summary>
    /// <param name="Id">The integer index of the particle to anchor.</param>
    /// <param name="P">The target position to keep the particle at.</param>
    /// <param name="K">Strength of the Anchor. For an absolute anchor, you can use double.MaxValue here.</param>
    public GrassVRAnchor(Point3d BaseP, Point3d P, double R, double k)
    {
      PIndex = new int[1] { -1 };
      Move = new Vector3d[1];
      Weighting = new double[1] { k };
      Strength = k;
      Range = R;
      Pt = P;
      InsPt = BaseP;
    }

    /// <summary>
    /// Construct a new Anchor object by position.
    /// </summary>
    /// <param name="P">Particle starting position. Also used as the target position to keep the particle at.</param>
    /// <param name="K">Strength of the Anchor. For an absolute anchor, you can use double.MaxValue here.</param>
    public GrassVRAnchor(Point3d P, double R, double k)
    {
      PPos = new Point3d[1] { P };
      Move = new Vector3d[1];
      Weighting = new double[1]{k};
      Strength = k;
      Range = R;
      Pt = P;
    }

    public override void Calculate(List<KangarooSolver.Particle> p)
    {
      //search index only on the first iteration with PIndex==-1
      if (PIndex[0] == -1)
      { PIndex[0] = SearchIndex(p); }
      if (PIndex[0] == -1)
      {

      }
      //problem if change pt without restart iteration => change force base point need to call the restart of the iteration for kangaroo (chek if automatic or not)

      Move[0] = Pt - p[PIndex[0]].Position;
      Weighting[0] = Strength;
    }
    public int SearchIndex(List<KangarooSolver.Particle> p)
    {
      int L = p.Count;
      Vector3d[] dist = new Vector3d[L];
      double[] DistVal = new double[L];


      for (int i = 0; i < L - 1; i++)
      {
        dist[i] = InsPt - p[i].Position;
        DistVal[i] = Math.Abs(dist[i].Length);

      }
      //base Point as minimum distance from insertion Pt
      if (Array.IndexOf(dist, dist.Min()) <= Range)
      { PIndex[0] = Array.IndexOf(dist, dist.Min()); }
      else
      {PIndex[0] = -1;}
      return PIndex[0];
    }
  }
# ---------- end onsurf ----------
# You will need to set the assembly
# reference location to your copy of
# KangarooSolver.dll
# Do this by right-clicking and then
# Manage Assemblies
onsurf_2 = CSharpScript(Pt=pop3d, S=brep, k=4, Reference="C:\Program Files\Rhino 7 WIP\Plug-ins\Grasshopper\Components\KangarooSolver.dll")  # -> out, A; inputs Pt: Point3d, S: Brep, k: Double
# ---------- onsurf_2: C# ----------
    A = new GrassVRAnchor(BaseP, Pt, k, S); //create an instance of your custom goal
# ---------- onsurf_2: C# additional code ----------
  public class GrassVRAnchor : GoalObject
  {
    public double Strength;
    public Point3d Pt;
    public Point3d InsPt;
    public int[] PIndex;
    public double Range;

    public GrassVRAnchor()
    {
    }

    /// <summary>
    /// Construct a new Anchor object by particle index and target position
    /// </summary>
    /// <param name="Id">The integer index of the particle to anchor.</param>
    /// <param name="P">The target position to keep the particle at.</param>
    /// <param name="K">Strength of the Anchor. For an absolute anchor, you can use double.MaxValue here.</param>
    public GrassVRAnchor(Point3d BaseP, Point3d P, double R, double k)
    {
      PIndex = new int[1] { -1 };
      Move = new Vector3d[1];
      Weighting = new double[1] { k };
      Strength = k;
      Range = R;
      Pt = P;
      InsPt = BaseP;
    }

    /// <summary>
    /// Construct a new Anchor object by position.
    /// </summary>
    /// <param name="P">Particle starting position. Also used as the target position to keep the particle at.</param>
    /// <param name="K">Strength of the Anchor. For an absolute anchor, you can use double.MaxValue here.</param>
    public GrassVRAnchor(Point3d P, double R, double k)
    {
      PPos = new Point3d[1] { P };
      Move = new Vector3d[1];
      Weighting = new double[1]{k};
      Strength = k;
      Range = R;
      Pt = P;
    }

    public override void Calculate(List<KangarooSolver.Particle> p)
    {
      //search index only on the first iteration with PIndex==-1
      if (PIndex[0] == -1)
      { PIndex[0] = SearchIndex(p); }
      if (PIndex[0] == -1)
      {

      }
      //problem if change pt without restart iteration => change force base point need to call the restart of the iteration for kangaroo (chek if automatic or not)

      Move[0] = Pt - p[PIndex[0]].Position;
      Weighting[0] = Strength;
    }
    public int SearchIndex(List<KangarooSolver.Particle> p)
    {
      int L = p.Length;
      floa[] dist = new float[L];

      for (int i = 0; i < L - 1; i++)
      {
        dist[i] = abs(InsPt.Position - p[i].Position);
      }
      //base Point as minimum distance from insertion Pt
      if (Array.IndexOf(dist, dist.Min()) <= Range)
      { PIndex[0] = Array.IndexOf(dist, dist.Min()); }
      else
      {PIndex[0] = -1}

    }
  }
# ---------- end onsurf_2 ----------
panel = Panel(onsurf.A)
panel_2 = Panel(onsurf_2.out)
solver = Solver(
    GoalObjects=panel,
    Reset=Button(),
    Restart=False,
    Parallel=True,
    Threshold=1e-15,
    Tolerance=0.01,
    AddCurrent=False,
    On=True)  # -> V, O
