# Grasshopper definition CustomGoal_Example2.gh (Grasshopper 1.0.7)
# plug-ins: Kangaroo2 Components

crv = Curve(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)
number_slider = Slider(0.01, range=0..0.01)
constanttension1 = CSharpScript(L=crv, k="1", Reference="D:\Program Files\Rhino 6\Plug-ins\Grasshopper\Components\KangarooSolver.dll")  # -> out, A; inputs L: Line, k: Double
# ---------- constanttension1: C# usings ----------
using System.IO;
using System.Linq;
using System.Data;
using System.Drawing;
using System.Reflection;
using System.Windows.Forms;
using System.Xml;
using System.Xml.Linq;
using System.Runtime.InteropServices;

using Rhino.DocObjects;
using Rhino.Collections;
using GH_IO;
using GH_IO.Serialization;
using KPlankton;
using KangarooSolver;
using KangarooSolver.Goals;
# ---------- constanttension1: C# ----------
    A = new NewSpring1(L.From, L.To, k);
# ---------- constanttension1: C# additional code ----------
  public class NewSpring1 : GoalObject
  {
    public NewSpring1(Point3d s, Point3d e, double k)
    {
      PPos = new Point3d[2] { s, e }; //initial positions
      Move = new Vector3d[2];
      Weighting = new double[2]{k,k};
    }

    public override void Calculate(List<KangarooSolver.Particle> p)
    {
      var Positions = this.GetCurrentPositions(p);
      var StartPt = Positions[0];
      var EndPt = Positions[1];

      Vector3d CurrentVector = EndPt - StartPt;

      double CurrentLength = CurrentVector.Length;

      double RestLength = 5.0;

      double Stretch = CurrentLength - RestLength;

      CurrentVector.Unitize();

      Move[0] = 0.5 * CurrentVector * Stretch;
      Move[1] = -Move[0];
    }

    public override object Output(List<KangarooSolver.Particle> p)
    {
      return new Line(p[PIndex[0]].Position, p[PIndex[1]].Position);
    }
  }
# ---------- end constanttension1 ----------
show = Show(G=crv)
crv_2 = Curve(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)
show_2 = Show(G=crv_2)  # disabled
grab = Grab(On=True, Strength=1, Range=3)  # -> Grab, Anchors
constanttension = CSharpScript(L=crv_2, k="1", Reference="D:\Program Files\Rhino 6\Plug-ins\Grasshopper\Components\KangarooSolver.dll")  # -> out, A; inputs L: Line, k: Double
# ---------- constanttension: C# ----------
    A = new NewSpring(L.From, L.To, k);
# ---------- constanttension: C# additional code ----------
  public class NewSpring : GoalObject
  {
    public NewSpring(Point3d s, Point3d e, double k)
    {
      PPos = new Point3d[2] { s, e }; //initial positions
      Move = new Vector3d[2];
      Weighting = new double[2]{k,k};
    }

    public override void Calculate(List<KangarooSolver.Particle> p)
    {
      var Positions = this.GetCurrentPositions(p);
      var StartPt = Positions[0];
      var EndPt = Positions[1];

      Vector3d CurrentVector = EndPt - StartPt;

      double CurrentLength = CurrentVector.Length;

      double RestLength = 25;

      double Stretch = CurrentLength - RestLength;

      CurrentVector.Unitize();

      Move[0] = 0.5 * CurrentVector * Stretch;
      Move[1] = -Move[0];
    }

    public override object Output(List<KangarooSolver.Particle> p)
    {
      return new Line(p[PIndex[0]].Position, p[PIndex[1]].Position);
    }
  }
# ---------- end constanttension ----------
panel = Panel(constanttension1.out)
panel_2 = Panel([constanttension1.A, constanttension.A])
grab_2 = Grab(On=True, Strength=1, Range=3)
solver = Solver(
    GoalObjects=[grab_2, constanttension1.A, constanttension.A, show_2, show],
    Reset=Button(),
    Threshold=1e-15,
    Tolerance=0.01,
    On=True)  # -> I, V, O
c_script = CSharpScript()  # -> Out, A
panel_3 = Panel(solver.O)
