# Grasshopper definition GrabTest.gh (Grasshopper 0.9.76)
# plug-ins: Kangaroo2 Components

line = Line(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)
grab = Grab(On=True, Strength=1, Range=3)  # -> Grab, Anchors
length_line = LengthLine(Line=line, Strength=10)
solver = Solver(GoalObjects=[length_line, grab.Grab], Reset=False, Threshold=1e-15, Tolerance=0.01, On=True)  # -> I, V, O
