# Grasshopper definition polygonassemble.gh (Grasshopper 1.0.7)
# plug-ins: Kangaroo2 Components

mesh = Mesh([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])
medges = MeshEdges(Mesh=mesh)  # -> NakedEdges, InteriorEdges, NonManifoldEdges
grab = Grab(On=True, Strength=1, Range=3)  # -> Grab, Anchors
show = Show(G=mesh)
demesh = DeconstructMesh(Mesh=mesh)  # -> Vertices, Faces, Colours, Normals
anchor = Anchor(Point=demesh.Vertices, Target=<geometry referenced from the Rhino model>, Strength=10000)  # disabled
length_line = LengthLine(Line=medges.NakedEdges, Strength=100)
ms = MagnetSnap(Points=flatten(demesh.Vertices), Range=Slider(3, range=0..3), Strength=10)
grab_2 = Grab(On=True, Strength=1, Range=3)
solver = Solver(GoalObjects=[length_line, ms, show, anchor, grab_2], Reset=Button(), Threshold=1e-15, Tolerance=0.01, On=True)  # -> I, V, O
data = Data(solver.O)
