# Grasshopper definition kangaroo-shape+karamba-load - Copy.gh (Grasshopper 1.0.7)
# plug-ins: Kangaroo2 Components, karambaGH

srf = Surface(<surface referenced from the Rhino model>)
rec = Rectangle()
crv = Curve()
demesh = DeconstructMesh(Mesh=srf)  # -> Vertices, Faces, Colours, Normals
mesh = Mesh(<mesh referenced from the Rhino model>)
line = Line()
number_slider = Slider(61, range=0..100)
num = Number([0, 3, 7, 13, 17, 20])
num_2 = Number([42, 43, 44, 45, 46, 47, 48, 49, 50, 51, 52, 53, 54, 55, 56, 57, 58, 59, 60, 61])
num_3 = Number(42)
clean = CleanTree(RemoveNulls=True, RemoveInvalid=True, RemoveEmpty=False)
branch = TreeBranch(Tree=clean, Path="{0}", MaintainPaths=True)
split = SplitTree(Data=clean, Masks=flatten("{0}"))  # -> flatten(Positive), flatten(Negative)
Z = UnitZ(Factor=1)
mesh_2 = Mesh(split.Positive)
line_2 = Line(split.Negative)
tri = Triangulate(Mesh=mesh_2)  # -> Mesh, Count
multiplication = Multiplication(A=Z, B=Slider(2, range=0..10))
medges = MeshEdges(Mesh=tri.Mesh)  # -> NakedEdges, InteriorEdges, NonManifoldEdges
# erase multiples lines
line_3 = Line(flatten([medges.InteriorEdges, medges.NakedEdges, medges.NonManifoldEdges]))
mc = MeshCorners(Mesh=mesh_2, Angle=2.35619449)
rdlines = RemoveDuplicateLinesKaramba3D(Line=line_3, LimitDistance=0.005)  # -> OutLine, Info, Indexes
crosec = CrossSectionKaramba3D()  # disabled
supp = SupportKaramba3D(PosInd=mc, menu=[buttons(on, on, on, on, on, on)])
linetobeam = LineToBeamKaramba3D(Line=rdlines.OutLine, CrossSection=crosec, New=True, Remove=True, LimitDistance_m=0.005)  # -> Element, Points, Info
loads = LoadsKaramba3D(
    Vector=multiplication,
    Mesh=mesh_2,
    BeamIdentifiers=linetobeam.Element,
    LCase=0,
    mode="MeshLoad -Const.",
    menu=[buttons(on, off, off), buttons(on, on)])
assemble = AssembleModelKaramba3D(Elem=linetobeam.Element, Support=supp, Load=loads, LimitDistance_m=0.005)  # -> Model, Info, Mass_kg, CenterOfGravity
analyze = AnalyzeKaramba3D(Model=assemble.Model)  # -> CalculatedModel, MaximumDisplacement_cm, ResultingForceOfGravity_kN, ElasticEnergy_kNm
modelview = ModelViewKaramba3D(Model=analyze.CalculatedModel, ResultFactors=1, ResultCase=-1)  # -> Model, DeformedMesh, DeformedAxes, DeformedModel
beamview = BeamViewKaramba3D(Model=modelview.Model)  # -> Model, MeshesOfRenderedBeams, DeformedBeamAxes, LegendColors, LegendTags
legend = Legend(Colour=beamview.LegendColors, Tags=beamview.LegendTags, LegendType=1)
mesh_3 = Mesh(beamview.MeshesOfRenderedBeams)

# ----
# multiple anchors
# Spring/line length goal
# load goal
# Anchor goal
# Show mesh goal
mplane = MeshPlane(Boundary={Plane=PlaneXY(0, 0, 0), Size=Domain2(u=-10..10, v=-10..10)}, WidthCount=10, HeightCount=10)  # -> Mesh, Area
tri_2 = Triangulate(Mesh=mplane.Mesh)  # -> Mesh, Count; disabled
show = Show(G=mesh)
nv = NakedVertices(Mesh=mesh)  # -> ClothedIndex, NakedIndex, ClothedPts, NakedPts
medges_2 = MeshEdges(Mesh=[tri_2.Mesh, mesh])  # -> NakedEdges, InteriorEdges, NonManifoldEdges
demesh_2 = DeconstructMesh(Mesh=[tri_2.Mesh, mesh])  # -> Vertices, Faces, Colours, Normals
mc_2 = MeshCorners(Mesh=[tri_2.Mesh, mesh], Angle=2.35619449)
merge = Merge(Data1=medges_2.NakedEdges, Data2=medges_2.InteriorEdges)
pt = Point(nv.NakedPts)
pt_2 = Point(nv.ClothedPts)
num_4 = Number([0, 1, 9, 10, 11, 12, 30, 28, 27, 39, 38, 29])
Z_2 = UnitZ(Factor=Slider(0.8, range=0..10))
len = Length(Curve=merge)
item = ListItem(List=pt, Index=num_4, Wrap=True)
load = Load(Point=demesh_2.Vertices, ForceVector=Z_2, Weighting=1)
multiplication_2 = Multiplication(A=len, B=Slider(0.27, range=0..1))
pt_3 = Point(item)  # disabled
grab = Grab(On=True, Strength=1, Range=3)
length_line = LengthLine(Line=merge, Length=multiplication_2, Strength=Slider(8.56, range=0..10))

line_4 = Line(medges_2.NakedEdges)
pt_4 = Point(demesh_2.Vertices)
end = EndPoints(Curve=line_4)  # -> Start, End
item_2 = ListItem(List=end.Start, Index=num, Wrap=True)
item_3 = ListItem(List=end.End, Index=num_2, Wrap=True)
item_4 = ListItem(List=end.Start, Index=num_3, Wrap=True)
pt_5 = Point([item_2, item_3, item_4])

anchor = Anchor(Point=pt_5, Strength=10000)
merge_2 = Merge(Data1=length_line, Data2=load, Data3=anchor, Data4=show, Data5=grab)
solver = Solver(GoalObjects=merge_2, Reset=Button(), Threshold=1e-15, Tolerance=0.01, On=True)  # -> I, V, O
geo = Geometry(solver.O)
