# Grasshopper definition kangaroo-shape+karamba-load.gh (Grasshopper 1.0.7)
# plug-ins: Kangaroo2 Components, karambaGH

branch = TreeBranch(MaintainPaths=True)
Z = UnitZ(Factor=-1)
multiplication = Multiplication(A=Z, B=Slider(3, range=0..10))
cross_section = CrossSectionKaramba3D(
    FamilyNameOfCrossSection="DefaultCroSec",
    Material=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,
    Diameter_cm=11.43,
    WallThickness_cm=0.4,
    mode="Circular Hollow")
support = SupportKaramba3D()
panel = Panel(cross_section)
crosec = CrossSectionKaramba3D(cross_section)  # disabled
deletef = DeleteFaces()
supp = SupportKaramba3D(menu=[buttons(off, off, off, off, off, off)])
geo = Geometry()
loads = LoadsKaramba3D(Vector=Vector(0, 0, -1), LCase=0, mode="Gravity")
loads_2 = LoadsKaramba3D(Local=False, LCase=0, mode="Point")
loads_3 = LoadsKaramba3D(LCase=0, mode="MeshLoad -Const.", menu=[buttons(on, off, off), buttons(on, on)])

# ----
# multiple anchors
# Spring/line length goal
# load goal
# Anchor goal
# Show mesh goal
mplane = MeshPlane(
    Boundary={Plane=PlaneXY(0, 0, 0), Size=Domain2(u=-10..10, v=-10..10)},
    WidthCount=Slider(2, range=-1..10),
    HeightCount=Slider(2, range=0..10))  # -> Mesh, Area
tri = Triangulate(Mesh=mplane.Mesh)  # -> Mesh, Count; disabled
show = Show(G=mplane.Mesh)
nv = NakedVertices(Mesh=mplane.Mesh)  # -> ClothedIndex, NakedIndex, ClothedPts, NakedPts
demesh = DeconstructMesh(Mesh=mplane.Mesh)  # -> Vertices, Faces, Colours, Normals
mc = MeshCorners(Mesh=mplane.Mesh, Angle=2.35619449)
pt = Point(nv.ClothedPts)
pt_2 = Point(nv.NakedPts)
num = Number([0, 1, 9, 10, 11, 12, 30, 28, 27, 39, 38, 29])
Z_2 = UnitZ(Factor=Slider(6.46, range=0..10))
anchor = Anchor(Point=mc, Strength=10000)
item = ListItem(List=pt_2, Index=num, Wrap=True)
load = Load(Point=demesh.Vertices, ForceVector=Z_2, Weighting=1)
pt_3 = Point(item)  # disabled
grab = Grab(On=True, Strength=1, Range=3)

tri_2 = Triangulate(Mesh=mplane.Mesh)  # -> Mesh, Count

medges = MeshEdges(Mesh=tri_2.Mesh)  # -> NakedEdges, InteriorEdges, NonManifoldEdges
merge = Merge(Data1=medges.NakedEdges, Data2=medges.InteriorEdges)
len = Length(Curve=merge)
multiplication_2 = Multiplication(A=len, B=Slider(0.82, range=0..1))
length_line = LengthLine(Line=merge, Length=multiplication_2, Strength=Slider(1.17, range=0..10))
merge_2 = Merge(Data1=length_line, Data2=load, Data3=anchor, Data4=show, Data5=grab)
solver = Solver(GoalObjects=merge_2, Reset=Button(), Threshold=1e-15, Tolerance=0.01, On=True)  # -> I, V, O
geo_2 = Geometry(solver.O)

bang = ExplodeTree(Data=geo_2)  # -> Branch0, Branch1
clean = CleanTree(RemoveNulls=True, RemoveInvalid=True, RemoveEmpty=False, Tree=solver.O)
branch_2 = TreeBranch(Tree=clean, Path="{0}", MaintainPaths=True)
tri_3 = Triangulate(Mesh=bang.Branch1)  # -> Mesh, Count
split = SplitTree(Data=clean, Masks=flatten("{0}"))  # -> flatten(Positive), flatten(Negative)
mesh = Mesh(split.Positive)
line = Line(split.Negative)
tri_4 = Triangulate(Mesh=mesh)  # -> Mesh, Count
loads_4 = LoadsKaramba3D(Vector=multiplication, Mesh=mesh, LCase=0, mode="MeshLoad -Const.", menu=[buttons(on, off, off), buttons(on, on)])
medges_2 = MeshEdges(Mesh=tri_4.Mesh)  # -> NakedEdges, InteriorEdges, NonManifoldEdges
# erase multiples lines
line_2 = Line(flatten(medges_2.InteriorEdges))
mc_2 = MeshCorners(Mesh=mesh, Angle=2.35619449)
rdlines = RemoveDuplicateLinesKaramba3D(Line=line_2, LimitDistance=0.005)  # -> OutLine, Info, Indexes
supp_2 = SupportKaramba3D(PosInd=mc_2, menu=[buttons(on, on, on, on, on, on)])
meshtoshell = MeshToShellKaramba3D(Mesh=tri_4.Mesh, LimitDistance_m=0.005)  # -> Element, Points, Info
linetobeam = LineToBeamKaramba3D(Line=line, CrossSection=cross_section, New=True, Remove=True, LimitDistance_m=0.005)  # -> Element, Points, Info
loads_5 = LoadsKaramba3D(
    Vector=multiplication,
    Mesh=mesh,
    BeamIdentifiers=linetobeam.Element,
    mode="MeshLoad -Const.",
    menu=[buttons(on, off, off), buttons(on, on)])

# ----
# Karamba3d system
assemble = AssembleModelKaramba3D(Elem=linetobeam.Element, Support=supp_2, Load=loads_4, LimitDistance_m=0.005)  # -> Model, Info, Mass_kg, CenterOfGravity
analyze = AnalyzeKaramba3D(Model=assemble.Model)  # -> CalculatedModel, MaximumDisplacement_cm, ResultingForceOfGravity_kN, ElasticEnergy_kNm
modelview = ModelViewKaramba3D(Model=analyze.CalculatedModel, ResultFactors=1, ResultCase=-1)  # -> Model, DeformedMesh, DeformedAxes, DeformedModel
beamview = BeamViewKaramba3D(Model=modelview.Model)  # -> Model, MeshesOfRenderedBeams, DeformedBeamAxes, LegendColors, LegendTags
mesh_2 = Mesh(beamview.MeshesOfRenderedBeams)
legend = Legend(Colour=beamview.LegendColors, Tags=beamview.LegendTags, LegendType=1)
