# Grasshopper definition karambaExemple.gh (Grasshopper 1.0.7)
# plug-ins: Kangaroo2 Components, karambaGH, gHowl

branch = TreeBranch(MaintainPaths=True)

# ----
# Initial geometry
line = Line([Line((-9.999156136, -9.999156136, 0.001622836692), (0.2073130886, -8.732509837, 7.818339004)), Line((-9.999156136, -9.999156136, 0.001622836692), (-8.732509837, 0.2073130886, 7.818339004)), Line((0.2073130886, -8.732509837, 7.818339004), (9.999548575, -9.999548575, 0.001284163269)), Line((9.999548575, -9.999548575, 0.001284163269), (8.732509837, -0.2073130886, 7.818339004)), Line((-8.732509837, 0.2073130886, 7.818339004), (-9.999548575, 9.999548575, 0.001284163269)), Line((8.732509837, -0.2073130886, 7.818339004), (9.999156136, 9.999156136, 0.001622836692))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])
mesh = Mesh(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)

cp = ControlPoints(Curve=graft(line))  # -> Points, Weights, Knots

# ----
# Initial model
panel = Panel(cp.Points)
timer = Timer(Interval=1, TimerInterval=5, Target=udp)  # disabled
udp = UDPSender(Address="127.0.0.1", Port="5000", Pattern="0", Data=panel)

cross_section = CrossSectionKaramba3D(
    FamilyNameOfCrossSection="DefaultCroSec",
    Material=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,
    Diameter_cm=11.43,
    WallThickness_cm=0.4,
    mode="Circular Hollow")
Z = UnitZ(Factor=-1)
mc = MeshCorners(Mesh=mesh, Angle=2.35619449)

# ----
# GrassVR
# control point handler
demesh = DeconstructMesh(Mesh=mesh)  # -> Vertices, Faces, Colours, Normals
grassvrhandler = CSharpScript(
    ModelPtList=demesh.Vertices,
    Mesh=mesh,
    SupportFrame=mc,
    SnapR=Slider(0.2, range=0..2),
    RecPort="7001",
    Reference=["C:\Users\giaco\Documents\tesi\scripts\DataConvTry\DataConvTry\bin\Release\netcoreapp2.1\DataConvTry.dll", "C:\Users\giaco\Documents\tesi\DLL\System.Linq.dll", "C:\Users\giaco\Documents\tesi\scripts\Grasshopper\GaviVRPlugin\GaviVRPlugin\bin\GaviVRPlugin.gha"])  # -> MeshOut, Frame, LP, LV, LW; inputs RecPort: Boolean
# ---------- grassvrhandler: C# usings ----------
using System.Linq;
# ---------- grassvrhandler: C# additional code ----------
  public int c;
  public static List<Point3d> Static;
  public bool hasStarted;
  public List<Point3d> List1 = new List<Point3d>();
  string[] ToRemove = new string[] {"{", "}"};

  List<string> RecivedData(string text)
  {
    if(text != null)
    {List<string> a = text.Split('\n').ToList();
      Console.WriteLine(0 + a[0] + 1 + a[1]);
      return a;}
    else
    {Console.WriteLine("Null");
      return new List<string>();}

  }
  List<Point3d> LoadList(List<Point3d> InList)
  {

    if (!hasStarted)
    {
      return InList;
    }
    else
    {
      if(Static.Count <= 0)
      {return InList;}
      else
      {return Static;}
    }
  }
  void Add(string Data)
  {
    Point3d Pt = Strg2Pt(Data);
    List1.Add(Pt);
  }
  void Del(string Data)
  {
    foreach (var c in ToRemove)
    {
      Data = Data.Replace(c, string.Empty);
    }
    int Index = Int32.Parse(Data);
    if(Index < List1.Count)
      List1.RemoveAt(Index);
    else
    {Print("Out of range Delete Index");
      Console.WriteLine("Out of range Delete Index");}
  }
  Point3d Strg2Pt(string String)
  {

    foreach (var c in ToRemove)
    {
      String = String.Replace(c, string.Empty);
    }
    string[] Splt = String.Split(',');
    float[] Position = {float.Parse(Splt[0]),
      float.Parse(Splt[1]),
      float.Parse(Splt[2])};
    return new Point3d(Position[0], Position[1], Position[2]);
  }


  /// <summary>
  /// This method will be called once every solution, before any calls to RunScript.
  /// </summary>
  public override void BeforeRunScript()
  {if (c <= 0)
      hasStarted = false;
    else
      hasStarted = true;
  }
  /// <summary>
  /// This method will be called once every solution, after any calls to RunScript.
  /// </summary>
  public override void AfterRunScript()
  {c++;}
# ---------- end grassvrhandler ----------

multiplication = Multiplication(A=Z, B=Slider(3, range=0..10))
linetobeam = LineToBeamKaramba3D(Line=line, CrossSection=cross_section, New=True, Remove=True, LimitDistance_m=0.005)  # -> Element, Points, Info

# ----
# Control elements
supp = SupportKaramba3D(PosInd=[grassvrhandler.Frame, mc], menu=[buttons(on, on, on, on, on, on)])
loads = LoadsKaramba3D(Vector=multiplication, Mesh=mesh, LCase=0, mode="MeshLoad -Const.", menu=[buttons(off, on, off), buttons(on, on)])

# ----
# Karamba3d system
assemble = AssembleModelKaramba3D(Elem=linetobeam.Element, Support=supp, Load=loads, LimitDistance_m=0.005)  # -> Model, Info, Mass_kg, CenterOfGravity
analyze = AnalyzeKaramba3D(Model=assemble.Model)  # -> CalculatedModel, MaximumDisplacement_cm, ResultingForceOfGravity_kN, ElasticEnergy_kNm
modelview = ModelViewKaramba3D(Model=analyze.CalculatedModel, ResultFactors=1, ResultCase=-1)  # -> Model, DeformedMesh, DeformedAxes, DeformedModel
beamview = BeamViewKaramba3D(Model=modelview.Model)  # -> Model, MeshesOfRenderedBeams, DeformedBeamAxes, LegendColors, LegendTags
mesh_2 = Mesh(beamview.MeshesOfRenderedBeams)
legend = Legend(Colour=beamview.LegendColors, Tags=beamview.LegendTags, LegendType=1)

# ----
# DeformedMesh
demesh_2 = DeconstructMesh(Mesh=mesh_2)  # -> Vertices, Faces, Colours, Normals
panel_2 = Panel([demesh_2.Vertices, demesh_2.Faces, demesh_2.Colours])
timer_2 = Timer(Interval=1, TimerInterval=5, Target=udp_2)  # disabled
udp_2 = UDPSender(Address="127.0.0.1", Port="5000", Pattern="0", Data=panel_2)

# ----
# multiple anchors
# Spring/line length goal
# load goal
# Anchor goal
# Show mesh goal
mplane = MeshPlane(
    Boundary={Plane=PlaneXY(0, 0, 0), Size=Domain2(u=-10..10, v=-10..10)},
    WidthCount=Slider(2, range=-1..10),
    HeightCount=Slider(2, range=0..10))  # -> Mesh, Area
tri = Triangulate(Mesh=mplane.Mesh)  # -> Mesh, Count; disabled
show = Show(G=mplane.Mesh)
nv = NakedVertices(Mesh=mplane.Mesh)  # -> ClothedIndex, NakedIndex, ClothedPts, NakedPts
demesh_3 = DeconstructMesh(Mesh=mplane.Mesh)  # -> Vertices, Faces, Colours, Normals
mc_2 = MeshCorners(Mesh=mplane.Mesh, Angle=2.35619449)
pt = Point(nv.ClothedPts)
pt_2 = Point(nv.NakedPts)
num = Number([0, 1, 9, 10, 11, 12, 30, 28, 27, 39, 38, 29])
Z_2 = UnitZ(Factor=Slider(6.46, range=0..10))
anchor = Anchor(Point=mc_2, Strength=10000)
item = ListItem(List=pt_2, Index=num, Wrap=True)
load = Load(Point=demesh_3.Vertices, ForceVector=Z_2, Weighting=1)
pt_3 = Point(item)  # disabled
grab = Grab(On=True, Strength=1, Range=3)

tri_2 = Triangulate(Mesh=mplane.Mesh)  # -> Mesh, Count

medges = MeshEdges(Mesh=tri_2.Mesh)  # -> NakedEdges, InteriorEdges, NonManifoldEdges
merge = Merge(Data1=medges.NakedEdges, Data2=medges.InteriorEdges)
len = Length(Curve=merge)
multiplication_2 = Multiplication(A=len, B=Slider(0.82, range=0..1))
length_line = LengthLine(Line=merge, Length=multiplication_2, Strength=Slider(1.17, range=0..10))
merge_2 = Merge(Data1=length_line, Data2=load, Data3=anchor, Data4=show, Data5=grab)
solver = Solver(GoalObjects=merge_2, Reset=Button(), Threshold=1e-15, Tolerance=0.01, On=True)  # -> I, V, O
geo = Geometry(solver.O)

bang = ExplodeTree(Data=geo)  # -> Branch0, Branch1
clean = CleanTree(RemoveNulls=True, RemoveInvalid=True, RemoveEmpty=False, Tree=solver.O)
branch_2 = TreeBranch(Tree=clean, Path="{0}", MaintainPaths=True)
tri_3 = Triangulate(Mesh=bang.Branch1)  # -> Mesh, Count
split = SplitTree(Data=clean, Masks=flatten("{0}"))  # -> flatten(Positive), flatten(Negative)
