# Grasshopper definition unnamed.gh (Grasshopper 1.0.7)
# plug-ins: gHowl

txt = Text("C:\Users\giaco\Desktop\new.xlm")
box = Box({Plane=PlaneXY(-5.491303622, -4.946365094, 0), X=Domain(0, 21.6298677), Y=Domain(0, 14.16840171), Z=Domain(0, 10.3691479)})
panel = Panel(txt)
demesh = DeconstructMesh(Mesh=box)  # -> Vertices, Faces, Colours, Normals
txt_2 = Text("6002")
txt_3 = Text("6001")
txt_4 = Text("0")
panel_2 = Panel(demesh.Vertices)
panel_3 = Panel(demesh.Faces)
udp = UDPSender(Port=txt_3, Pattern=txt_4, Data=panel_2)
udp_2 = UDPSender(Port=txt_2, Pattern=txt_4, Data=panel_3)
panel_4 = Panel(udp)
panel_5 = Panel(udp_2)
